# Grasshopper definition A2 Boilerplate.gh (Grasshopper 1.0.8)
# plug-ins: RhinoCodePluginGH

# ---- group: Rendering Options
southwest_color = ColourSwatch(SwatchColor=RGB(142, 183, 237))
southeast_color = ColourSwatch(SwatchColor=RGB(194, 187, 240))
north_color = ColourSwatch(SwatchColor=RGB(240, 225, 242))
origin = Point(Point(0, 0, 0))
entwine = Entwine(Branch00=north_color, Branch01=southeast_color, Branch02=southwest_color, FlattenInputs=True)
create_material = CreateMaterial(Diffuse=entwine, Specular=RGB(255, 255, 255), Emission=RGB(0, 0, 0), Transparency=0, Shine=0)

# ---- group: Parameters
preparation_strategy = ValueList({"Random Bubble Sort": "random bubble", "Sort along U then along V": "u then v", "Sort along V then along U": "v then u", "All Zero": "all 0", "All Maximum Height": "all max"}, selected="All Maximum Height")
extent_u = Slider(5, range=2..30)
extent_v = Slider(5, range=2..30)
extent_w = Slider(5, range=2..30)
seed = Slider(257, range=0..1000)

# ---- group: Create a list of random integers from 0 to Extent W (Don't change)
addition = Addition(A=extent_w, B=1)
mult = Multiplication(A=extent_u, B=extent_v)
construct_domain = ConstructDomain(DomainStart=0, DomainEnd=addition)
# The default behavior in Grasshopper for
# creating a sample of random integers
# is not uniform. This is because it rounds
# instead of floors (bad!)
random = Random(Range=construct_domain, Number=mult, Seed=seed)
expression = Expression(x=random, Expression="Floor(x)")

# ----
prepare_w_heights = PrepareW_heights(randomized_heights=expression, extent_v=extent_v, seed=seed, preparation_strategy=preparation_strategy)

# ---- group: Edit Me!
generate_faces = Python3Script(extent_u=extent_u, extent_v=extent_v, extent_w=extent_w, w_heights=prepare_w_heights)  # -> north_faces, southeast_faces, southwest_faces; inputs extent_u: Int32, extent_v: Int32, extent_w: Int32, w_heights: tree of Int32
# ---------- generate_faces: Python ----------
import itertools
from math import *

import ghpythonlib.treehelpers as th
import rhinoscriptsyntax as rs
from Rhino.Geometry import Surface, Vector3d


#
# For assignment directions, please go to
# https://russell-newton.github.io/DesignScripting/assignments/2-2D-cubies.html
#

###############################################################################
# This section is all setup
###############################################################################

#
# Inputs
#
extent_u: int
extent_v: int
extent_w: int
w_heights: list[list[int]] = th.tree_to_list(w_heights)

#
# Outputs
#
north_faces: list[Surface] = []
southeast_faces: list[Surface] = []
southwest_faces: list[Surface] = []

########

#
# Augment w_heights to make things easier.
# This inserts an all-zero row at the start and inserts a zero
#  to the start of every row.
#
for row in w_heights:
    row.insert(0, 0)
w_heights.insert(0, [0 for _ in range(extent_v + 1)])

###############################################################################



###############################################################################
# Helper Functions
###############################################################################

def get_point(u: int, v: int, w: int) -> Vector3d:
    """
    Returns the projected cubie corner at coordinates (u, v, w).

    :param u: The u coordinate of the cubie corner
    :param v: The v coordinate of the cubie corner
    :param w: The w coordinate of the cubie corner

    :return: A Rhino.Geometry.Vector3d with the coordinates of the cubie corner
        projected onto the XY plane (Z = 0)
    """
    return Vector3d(
        (u + v) * sqrt(3) / 2,
        (-u + v) / 2 + w,
        0
    )

###############################################################################



###############################################################################
# Things to Implement
###############################################################################

def add_north_face(west_u: int, west_v: int, w: int) -> None:
    """
    Add a north-facing surface to the "north_faces" list.

    See AddSrfPt in rhinoscriptsyntax and get_point above.

    :param west_u: The u coordinate of the western corner of the face
    :param west_v: The v coordinate of the western corner of the face
    :param w: The w coordinate of the face
    """

    # Replace this with your code
    raise NotImplementedError

def add_southeast_face(u: int, southwest_v: int, southwest_w: int) -> None:
    """
    Add a southeast-facing surface to the "southeast_faces" list.

    See AddSrfPt in rhinoscriptsyntax and get_point above.

    :param u: The u coordinate of the face
    :param southwest_v: The v coordinate of the southwestern corner of the face
    :param southwest_w: The w coordinate of the southwestern corner of the face
    """

    # Replace this with your code
    raise NotImplementedError

def add_southwest_face(southwest_u: int, v: int, southwest_w: int) -> None:
    """
    Add a southwest-facing surface to the "southwest_faces" list.

    See AddSrfPt in rhinoscriptsyntax and get_point above.

    :param southwest_u: The u coordinate of the southwestern corner of the face
    :param v: The v coordinate of the face
    :param southwest_w: The w coordinate of the southwestern corner of the face
    """

    # Replace this with your code
    raise NotImplementedError

# This nested for-loop provides u and v coordinates of the westernmost corner of each cubie stack
for u in range(extent_u):
    u_idx = extent_u - u  # Just used to get w, do not use this when adding faces
    for v in range(extent_v):
        v_idx = v + 1  # Just used to get w, do not use this when adding faces

        w = w_heights[u_idx][v_idx]  # The height of the current cubie stack
        w_southeast = w_heights[u_idx - 1][v_idx]  # The height of the cubie stack to the southeast
        w_southwest = w_heights[u_idx][v_idx - 1]  # The height of the cubie stack to the southwest

        # TODO - Add the following faces:
        #   The topmost face of the stack (north)
        #   The southeast faces of the stack (from w_southeast up to w)
        #   The southwest faces of the stack (from w_southwest up to w)

        # Replace this with your code
        raise NotImplementedError

        # If this cubie stack is against the northwest "wall", you need to add the faces of the wall
        if u == 0:
            # TODO - Add the following faces:
            #   Southeasterly faces of the "wall" to the northwest of the cubie stack
            #    these will go from w up to extent_w
            
            # Replace this with your code
            raise NotImplementedError

        # If this cubie stack is against the northeast "wall", you need to add the faces of the wall
        if v == extent_v - 1:
            # TODO - Add the following faces:
            #   Southwesterly faces of the "wall" to the northeast of the cubie stack
            #    these will go from w up to extent_w

            # Replace this with your code
            raise NotImplementedError

###############################################################################



###############################################################################
# Convert outputs to trees
###############################################################################
north_faces = th.list_to_tree(north_faces)
southeast_faces = th.list_to_tree(southeast_faces)
southwest_faces = th.list_to_tree(southwest_faces)
# ---------- end generate_faces ----------

# ---- group: If you want to preview an individual output, here you go
surface = Surface(generate_faces.north_faces)
surface_2 = Surface(generate_faces.southeast_faces)
surface_3 = Surface(generate_faces.southwest_faces)

# ----
entwine_2 = Entwine(Branch00=surface, Branch01=surface_2, Branch02=surface_3, FlattenInputs=True)
move = Move(Geometry=entwine_2, Motion=origin)  # -> Geometry, Transform
custom_preview = CustomPreview(Geometry=move.Geometry, Material=create_material)

# ==== cluster PrepareW_heights
randomized_heights = ClusterInput()  # Provide this input with a randomized list of height values (0 to W Extent)
extent_v = ClusterInput()
partition_list = PartitionList(RandomizedHeights=randomized_heights, ExtentV=extent_v)
preparation_strategy = ClusterInput()
path_mapper = PathMapper(partition_list, source="{0;0;A}", target="{0;A}")
seed = ClusterInput()
prepare_w_heights = Python3Script(numbers=path_mapper, seed=seed, strategy=preparation_strategy)  # -> w_heights; inputs numbers: tree of Int32, seed: Int32
# ---------- prepare_w_heights: Python ----------
import random
from typing import Iterator, Literal

import ghpythonlib.treehelpers as th

numbers: list[list[int]] = th.tree_to_list(numbers)
seed: int
strategy: Literal["random bubble", "u then v", "v then u", "all 0", "all max"]

extent_u: int = len(numbers)
extent_v: int = len(numbers[0])

random.seed(seed)

def random_bubble():

    def snake() -> Iterator[tuple[int, int]]:
        switch_direction = False
        for j in range(0, extent_v + extent_u - 1):
            if switch_direction:
                for i in range(extent_u):
                    if not (0 <= j - i < extent_v):
                        continue
                    yield i, j - i
            else:
                for i in range(extent_u - 1, -1, -1):
                    if not (0 <= j - i < extent_v):
                        continue
                    yield i, j - i
            switch_direction = not switch_direction

    def bubble(u, v):
        changed = False
        done = False
        while not done:
            done = True
            if random.choice([True, False]):
                # Check swap right first
                if v < extent_v - 1 and numbers[u][v] > numbers[u][v + 1]:
                    numbers[u][v], numbers[u][v + 1] = numbers[u][v + 1], numbers[u][v]
                    v += 1
                    done = False
                    changed = True
                elif u < extent_u - 1 and numbers[u][v] > numbers[u + 1][v]:
                    numbers[u][v], numbers[u + 1][v] = numbers[u + 1][v], numbers[u][v]
                    u += 1
                    done = False
                    changed = True
            else:
                # Check swap down first
                if u < extent_u - 1 and numbers[u][v] > numbers[u + 1][v]:
                    numbers[u][v], numbers[u + 1][v] = numbers[u + 1][v], numbers[u][v]
                    u += 1
                    done = False
                    changed = True
                elif v < extent_v - 1 and numbers[u][v] > numbers[u][v + 1]:
                    numbers[u][v], numbers[u][v + 1] = numbers[u][v + 1], numbers[u][v]
                    v += 1
                    done = False
                    changed = True
        return changed

    done = False
    while not done:
        done = True
        for u, v in snake():
            if bubble(u, v):
                done = False

def u_then_v():
    for v in range(extent_v):
        sorted_column = sorted(numbers[u][v] for u in range(extent_u))
        for u in range(extent_u):
            numbers[u][v] = sorted_column[u]
    for u in range(extent_u):
        numbers[u] = sorted(numbers[u])

def v_then_u():
    for u in range(extent_u):
        numbers[u] = sorted(numbers[u])
    for v in range(extent_v):
        sorted_column = sorted(numbers[u][v] for u in range(extent_u))
        for u in range(extent_u):
            numbers[u][v] = sorted_column[u]

def all_zero():
    for u in range(extent_u):
        for v in range(extent_v):
            numbers[u][v] = 0

def all_max():
    max_height = max(
        max(row)
        for row in numbers
    )
    for u in range(extent_u):
        for v in range(extent_v):
            numbers[u][v] = max_height

if strategy == "random bubble":
    random_bubble()
elif strategy == "u then v":
    u_then_v()
elif strategy == "v then u":
    v_then_u()
elif strategy == "all 0":
    all_zero()
elif strategy == "all max":
    all_max()
else:
    raise ValueError(f"Invalid strategy: {strategy}")

w_heights = th.list_to_tree(numbers)
# ---------- end prepare_w_heights ----------
w_heights = ClusterOutput(prepare_w_heights)
