# Grasshopper definition A3-boilerplate.gh (Grasshopper 1.0.8)
# plug-ins: RhinoCodePluginGH

# ---- group: Parameters
two_edges_chance = Slider(0.25, range=0..1)
grid_height = Slider(14, range=0..30)
grid_width = Slider(20, range=0..50)
seed_count = Slider(30, range=0..30)
prng_seed = Slider(435, range=0..1000)

# ---- group: Implement Me!
create_clusters = Python3Script(
    grid_height=grid_height,
    grid_width=grid_width,
    cluster_seed_count=seed_count,
    prng_seed=prng_seed,
    two_edges_chance=two_edges_chance)  # -> connections, grid; inputs grid_height: Int32, grid_width: Int32, cluster_seed_count: Int32, prng_seed: Int32, two_edges_chance: Double
# ---------- create_clusters: Python ----------
import functools
import random

import ghpythonlib.treehelpers as th
from Rhino.Geometry import Vector3d


#############################################################
# Inputs
#############################################################

grid_height: int
grid_width: int
cluster_seed_count: int
prng_seed: int
two_edges_chance: float


#############################################################
# Set-Up
#############################################################

# The following are type aliases that can be used in type-hints
GridPoint = tuple[int, int]
ClusterEdge = tuple[GridPoint, GridPoint]
ClusterPoints = dict[int, set[GridPoint]]
ClusterEdges = dict[int, list[ClusterEdge]]

# Set PRNG seed
random.seed(prng_seed)


#############################################################
# Helper Functions
#############################################################

adjacency_directions = ((-1, 0), (1, 0), (0, -1), (0, 1))
def is_adjacent_to(a: GridPoint, b: GridPoint) -> bool:
    """
    Determine if two GridPoints, a and b are adjacent.

    :param a: The first GridPoint
    :param b: The second GridPoint
    :return: True, if a and b are adjacent, False otherwise.
    """

    # any returns True if any of the items in the provided iterable are True
    return any(
        a == (b[0] + offset_x, b[1] + offset_y)
        for offset_x, offset_y in adjacency_directions
    )

def is_on_frontier(
    claimed: set[GridPoint],
    point: GridPoint
) -> bool:
    """
    Determine if a GridPoint, point, is adjacent to any GridPoint that has already
    been claimed by a cluster.

    :param claimed: The set of claimed GridPoints
    :param point: The GridPoint to check
    :return: True, if point is adjacent to any claimed GridPoint, False otherwise.
    """

    # any returns True if any of the items in the provided iterable are True
    return any(
        (point[0] + offset_x, point[1] + offset_y) in claimed
        for offset_x, offset_y in adjacency_directions
    )

def subclusters_adjacent_to(
    cluster_points: ClusterPoints,
    point: GridPoint
) -> ClusterPoints:
    """
    Return a map from cluster number, i to set of GridPoints in cluster i that are adjacent
    to a GridPoint, point.

    :param cluster_points: The map from cluster number, i to the set of GridPoints in cluster i.
    :param point: The GridPoint to find the subclusters it is adjacent to.
    :return: The map of subclusters adjacent to point.
    """
    
    subclusters = {
        i: set(filter(functools.partial(is_adjacent_to, point), cluster))
        for i, cluster in cluster_points.items()
    }
    # Perform a second filter step to ignore empty subclusters
    return {
        i: subcluster
        for i, subcluster in subclusters.items()
        if subcluster
    }

def smallest_cluster_idx(cluster_points: ClusterPoints) -> int:
    """
    Returns the number of the smallest cluster provided in cluster_points.

    :param cluster_points: A map from cluster number, i, to the set of GridPoints in cluster i.
    :return: min_i, the number of the smallest cluster provided in cluster_points.
    """

    return min(cluster_points, key=lambda i: len(cluster_points[i]))

#############################################################
# Implementation
#############################################################

def get_cluster_seeds(unclaimed: set[GridPoint]) -> list[GridPoint]:
    """
    Sample cluster_seed_count GridPoints randomly from unclaimed, returning
    the sampled list.
    """

    # TODO: Implement the unclaimed point sampling
    raise NotImplementedError

def select_point_to_add(frontier: list[GridPoint]) -> GridPoint:
    """
    Select a random GridPoint from the frontier of unclaimed GridPoints
    adjacent to the current clusters.
    """

    # TODO: Select a random GridPoint from the frontier
    raise NotImplementedError

def create_clusters():
    # This is a set of all (x, y) in the grid.
    #   As points are claimed by clusters, this set will shrink
    unclaimed: set[GridPoint] = set.union(*[  # unpacking a list of sets to provide to *args
            {
                (x, y) for y in range(grid_height)
            }
            for x in range(grid_width)
        ]
    )

    # Create cluster seeds, add to claimed set
    # TODO: implement get_cluster_seeds
    cluster_seeds = get_cluster_seeds(unclaimed)

    # Create the claimed set from the cluster seeds, remove them from unclaimed points
    claimed: set[GridPoint] = set(cluster_seeds)
    unclaimed -= claimed

    # Set up cluster_points, a map from cluster number i to a set of GridPoints in cluster i
    cluster_points: ClusterPoints = {
        i: {seed}
        for i, seed in enumerate(cluster_seeds)
    }
    # Set up cluster_edges, a map from cluster number i to a list of ClusterEdge in cluster i
    cluster_edges: ClusterEdges = {
        i: []
        for i in range(len(cluster_seeds))
    }

    def cluster_size(idx: int) -> int:
        """
        :param idx: The cluster number.
        :return: The size of cluster number idx.
        """
        return len(cluster_points[idx])

    while unclaimed:
        # Compute the fronteir by filtering unclaimed GridPoints to only those that are adjacent to claimed points
        frontier: list[GridPoint] = list(filter(functools.partial(is_on_frontier, claimed), unclaimed))

        # Pick a random GridPoint from the fronteir
        # TODO: Implement select_point_to_add
        to_add: GridPoint = select_point_to_add(frontier)

        # Compute the subclusters next to to_add
        subclusters_next_to: ClusterPoints = subclusters_adjacent_to(cluster_points, to_add)
        # Compute the cluster number of the smallest adjacent subcluster
        target_cluster: int = min(subclusters_next_to, key=cluster_size)
        # Get the set[GridPoint] representing the smallest adjacent subcluster
        target_cluster_points: set[GridPoint] = subclusters_next_to[target_cluster]

        # Add edge(s) to connect to_add to the target cluster
        # TODO:
        #   1. Select a random point from the target_cluster_points to use as the edge endpoint
        #   2. Add the new ClusterEdge to cluster_edges[target_cluster] (this will be a 2-tuple with to_add and your selected endpoint)
        #   3. Remove the selected endpoint from target_cluster_points
        #   4. If there are any remaining GridPoints in target_cluster_points:
        #         a. Sample a random number
        #         b. If that random number is less than or equal to two_edges_chance:
        #               i.  Pick a second random GridPoint from target_cluster_points
        #              ii. Create a new edge tuple with to_add and this second random GridPoint
        #             iii. Add this new edge to cluster_edges[target_cluster]
        raise NotImplementedError

        # Bookkeeping
        # TODO:
        #   1. Add to_add to the set of claimed GridPoints
        #   2. Add to_add to the set of GridPoints at cluster_points[target_cluster]
        #   3. Remove to_add from the unclaimed GridPoints
        raise NotImplementedError

    return cluster_points, cluster_edges


#############################################################
# Outputs
#############################################################
cluster_points, cluster_edges = create_clusters()
connections = th.list_to_tree(
    [
        [
            # Convert each edge in the cluster to the midpoint Vector3d of the edge
            (Vector3d(*edge_start, 0) + Vector3d(*edge_end, 0)) / 2
            for edge_start, edge_end in cluster_edges[i]
        ]
        for i in range(len(cluster_edges))  # For each cluster
    ]
)
grid = th.list_to_tree(
    [
        [
            # Convert each point in the cluster to a Vector3d
            Vector3d(*point, 0)
            for point in cluster_points[i]
        ]
        for i in range(len(cluster_edges))  # For each cluster
    ]
)
# ---------- end create_clusters ----------

# ----
merge = Merge(Data1=create_clusters.connections, Data2=create_clusters.grid)
series = Series(Start=1, Step=1, Count=seed_count)  # -> graft(Series)

# ---- group: Rendering Options
gradient = Gradient(
    LowerLimit=0,
    UpperLimit=seed_count,
    Parameter=series,
    stops=[0: RGB(0, 98, 0), 0.25: RGB(81, 175, 17), 0.5: RGB(159, 198, 146), 0.75: RGB(170, 235, 41), 1: RGB(221, 255, 53)])
origin = Point(Point(0, 0, 0))
scale = Slider(3.27, range=0..10)

# ----
multiplication = Multiplication(A=merge, B=scale)
addition = Addition(A=multiplication, B=origin)
division = Division(A=scale, B=4)
circle_cnr = CircleCNR(Center=addition, Normal=Vector(0, 0, 1), Radius=division)
boundary_surfaces = BoundarySurfaces(Edges=circle_cnr)
create_material = CreateMaterial(Diffuse=gradient, Specular=RGB(255, 255, 255), Emission=RGB(0, 0, 0), Transparency=0, Shine=0)
custom_preview = CustomPreview(Geometry=boundary_surfaces, Material=create_material)
