# Grasshopper definition A4-boilerplate.gh (Grasshopper 1.0.8)

# ---- group: Rule Selection
_0_0_0 = BooleanToggle(False)
_0_0_1 = BooleanToggle(False)
_0_1_0 = BooleanToggle(False)
_0_1_1 = BooleanToggle(False)
_1_0_0 = BooleanToggle(False)
_1_0_1 = BooleanToggle(False)
_1_1_0 = BooleanToggle(False)
_1_1_1 = BooleanToggle(False)
python_3_script = Python3Script(number=Slider(0, range=0..255))  # -> rules; inputs number: Int32
# ---------- python_3_script: Python ----------
rules = []

for _ in range(8):
    if number % 2 == 0:
        rules.append(False)
    else:
        rules.append(True)
    number >>= 1
# ---------- end python_3_script ----------
merge = Merge(Data1=_0_0_0, Data2=_0_0_1, Data3=_0_1_0, Data4=_0_1_1, Data5=_1_0_0, Data6=_1_0_1, Data7=_1_1_0, Data8=_1_1_1)

# ---- group: Rendering Options
cell_size = Slider(1, range=0..5)
surface_scale = Slider(1, range=0..2)
on_color = ColourSwatch(SwatchColor=RGB(49, 108, 140))
off_color = ColourSwatch(SwatchColor=RGB(242, 242, 242))

# ---- group: Parameters
length = Slider(15, range=3..49, expression="2*x+1")
generation_count = Slider(20, range=1..100)
value_at_left_boundary = ValueList({"Zero": "zero", "One": "one", "Wrap": "wrap", "Extend": "extend"}, selected="Zero")
value_at_right_boundary = ValueList({"Zero": "zero", "One": "one", "Wrap": "wrap", "Extend": "extend"}, selected="Zero")
first_generation_type = ValueList({"Left 1": "l1", "Centered 1": "c1", "Right 1": "r1", "Left 0": "l0", "Centered 0": "c0", "Right 0": "r0", "Randomized": "random"}, selected="Centered 1")
seed = Slider(320, range=0..1000)

# ---- group: Implement Me!
compute_generations = Python3Script(
    length=length,
    num_generations=generation_count,
    left_boundary_condition=value_at_left_boundary,
    right_boundary_condition=value_at_right_boundary,
    first_generation_type=first_generation_type,
    seed=seed,
    rules=merge)  # -> on_centers, off_centers; inputs length: Int32, num_generations: Int32, left_boundary_condition: String, right_boundary_condition: String, seed: Int32, rules: list of Boolean
# ---------- compute_generations: Python ----------
import random
from itertools import product
from typing import Literal, Sequence

from Rhino.Geometry import Vector3d


########################################################################
# Inputs
########################################################################


length: int
num_generations: int
left_boundary_condition: Literal["zero", "one", "wrap", "extend"]
right_boundary_condition: Literal["zero", "one", "wrap", "extend"]
first_generation_type: Literal["l1", "c1", "r1", "l0", "c0", "r0", "random"]
seed: int


########################################################################
# Type Aliases
########################################################################


# The state of a cell can either be 0 or 1.
CellState = Literal[0, 1]
# A cell's neighborhood is a 3-tuple of its left neighbor's state, its own state, and its right neighbor's state.
Neighborhood = tuple[CellState, CellState, CellState]
# A generation is a sequence of CellStates representing the entire grid.
Generation = Sequence[CellState]


########################################################################
# Input Processing
########################################################################


# Convert the rules input into a map from Neighborhood to next generation CellState
rules: dict[Neighborhood, CellState] = {
    neighborhood: 1 if state else 0
    for neighborhood, state in zip(product(range(2), repeat=3), rules)
}

random.seed(seed)


########################################################################
# Helper Functions
########################################################################


def left_boundary_behavior(
    gen: Generation
) -> CellState:
    """
    Provides the value to use as the left neighbor's CellState
    for the leftmost cell in the grid.

    :param gen: The current Generation.
    :return: The CellState to use, determined by the left_boundary_condition
        component input.
    """
    if left_boundary_condition == "zero":
        return 0
    elif left_boundary_condition == "one":
        return 1
    elif left_boundary_condition == "wrap":
        return gen[-1]
    elif left_boundary_condition == "extend":
        return gen[0]
    else:
        raise ValueError(f"Invalid value for left_boundary_condition: {left_boundary_condition}")

def right_boundary_behavior(
    gen: Generation
) -> CellState:
    """
    Provides the value to use as the right neighbor's CellState
    for the rightmost cell in the grid.

    :param gen: The current Generation.
    :return: The CellState to use, determined by the right_boundary_condition
        component input.
    """
    if right_boundary_condition == "zero":
        return 0
    elif right_boundary_condition == "one":
        return 1
    elif right_boundary_condition == "wrap":
        return gen[0]
    elif right_boundary_condition == "extend":
        return gen[-1]
    else:
        raise ValueError(f"Invalid value for right_boundary_condition: {right_boundary_condition}")

def get_first_generation() -> Generation:
    """
    :return: The first Generation, determined by the first_generation_type
        component input.
    """
    if first_generation_type == "l1":
        return (1,) + (0,) * (length - 1)
    elif first_generation_type == "c1":
        return (0,) * ((length - 1) // 2) + (1,) + (0,) * ((length - 1) // 2 + (length - 1) % 2)
    elif first_generation_type == "r1":
        return (0,) * (length - 1) + (1,)
    elif first_generation_type == "l0":
        return (0,) + (1,) * (length - 1)
    elif first_generation_type == "c0":
        return (1,) * ((length - 1) // 2) + (0,) + (1,) * ((length - 1) // 2 + (length - 1) % 2)
    elif first_generation_type == "r0":
        return (1,) * (length - 1) + (0,)
    elif first_generation_type == "random":
        return tuple(random.choices((0, 1), k=length))
    else:
        raise ValueError(f"Invalid value for first_generation_type: {first_generation_type}")


########################################################################
# Implementation
########################################################################


def get_neighborhood(
    gen: Generation,
    index: int
) -> Neighborhood:
    """
    Compute the Neighborhood of the grid cell at the provided index. Refer to the
    assignment description for more details.

    :param gen: The current Generation.
    :param index: The index of the grid cell to compute the neighborhood of.
    :return: The neighborhood of the grid cell at the provided index.
    """
    raise NotImplementedError

def next_state(
    gen: Generation,
    index: int
) -> CellState:
    """
    Compute the next Generation's CellState of the grid cell at the provided index.
    Refer to the assignment description for more details.

    :param gen: The current Generation.
    :param index: The index of the grid cell to compute the neighborhood of.
    :return: The next CellState of the grid cell at the provided index.
    """
    raise NotImplementedError

def next_generation(
    gen: Generation
) -> Generation:
    """
    Compute the Generation following a provided Generation. Refer to the assignment
    description for more details.

    :param gen: The current Generation.
    :return: The next Generation.
    """
    raise NotImplementedError

def generate() -> list[Generation]:
    """
    Compute all Generations, returning the list of computed Generations.
    Refer to the assignment description for more details.

    :return: A list of computed Generations.
    """
    raise NotImplementedError


########################################################################
# Output
########################################################################


generations = generate()

on_centers = []
off_centers = []
for gen in range(num_generations):
    for idx in range(length):
        if generations[gen][idx]:
            on_centers.append(Vector3d(idx, -gen, 0))
        else:
            off_centers.append(Vector3d(idx, -gen, 0))
# ---------- end compute_generations ----------

# ----
multiplication = Multiplication(A=cell_size, B=surface_scale)
construct_domain = ConstructDomain(DomainStart=expr("x/2", multiplication), DomainEnd=expr("-x/2", multiplication))
multiplication_2 = Multiplication(A=compute_generations.on_centers, B=cell_size)
multiplication_3 = Multiplication(A=compute_generations.off_centers, B=cell_size)
xy_plane = XYPlane(Origin=multiplication_2)
xy_plane_2 = XYPlane(Origin=multiplication_3)
create_material = CreateMaterial(Diffuse=on_color, Specular=RGB(255, 255, 255), Emission=RGB(0, 0, 0), Transparency=0, Shine=0)
create_material_2 = CreateMaterial(Diffuse=off_color, Specular=RGB(255, 255, 255), Emission=RGB(0, 0, 0), Transparency=0, Shine=0)
plane_surface = PlaneSurface(Plane=xy_plane, XSize=construct_domain, YSize=construct_domain)
plane_surface_2 = PlaneSurface(Plane=xy_plane_2, XSize=construct_domain, YSize=construct_domain)
custom_preview = CustomPreview(Geometry=plane_surface_2, Material=create_material_2)
custom_preview_2 = CustomPreview(Geometry=plane_surface, Material=create_material)
