# Grasshopper definition custom-tilings.gh (Grasshopper 1.0.8)
# plug-ins: RhinoCodePluginGH

point = Point(<point referenced from the Rhino model>)
point_2 = Point(<point referenced from the Rhino model>)
curve = Curve(<curve referenced from the Rhino model>)
point_3 = Point(<point referenced from the Rhino model>)
python_3_script = Python3Script(monotile=curve, start=point_3, right_start=point, up_start=point_2)  # -> path, right_index, up_index; inputs monotile: Polyline, start: Point3d, right_start: Point3d, up_start: Point3d
# ---------- python_3_script: Python ----------
from Rhino.Geometry import Polyline, Point3d, Vector3d

start_index: int = monotile.FindIndex(lambda x: start.EpsilonEquals(x, 1e-6))
right_index: int = monotile.FindIndex(lambda x: right_start.EpsilonEquals(x, 1e-6))
up_index: int = monotile.FindIndex(lambda x: up_start.EpsilonEquals(x, 1e-6))

points = list(monotile)
points = points[start_index:] + points[:start_index]
right_index -= start_index
if right_index < 0:
    right_index += len(points)
up_index -= start_index
if up_index < 0:
    up_index += len(points)

path = []
for i in range(1, len(points)):
    path.append(points[i] - points[i - 1])
path.append(points[0] - points[-1])
# ---------- end python_3_script ----------
python_3_script_2 = Python3Script(
    size_u=Slider(1.1, range=0.1..2),
    size_v=Slider(0.8, range=0.1..2),
    size_w=Slider(0.5, range=0.1..2),
    extent_right=Slider(4, range=1..20),
    extent_up=Slider(4, range=1..20))  # -> cells, points; inputs size_u: Double, size_v: Double, size_w: Double, extent_right: Int32, extent_up: Int32
# ---------- python_3_script_2: Python ----------
from math import cos, sin, pi

import ghpythonlib.treehelpers as th
import rhinoscriptsyntax as rs
from Rhino.Geometry import Vector3d

u_basis = size_u * Vector3d(1, 0, 0)
v_basis = size_v * Vector3d(cos(-pi / 3), sin(-pi / 3), 0)
w_basis = size_w * Vector3d(cos(pi / 3), sin(pi / 3), 0)

# Generate cells and points in tandem
cells = []
points = []
for i in range(extent_right):
    cell_row = []
    point_row = []
    for j in range(extent_up):
        west_corner = i * (u_basis + w_basis) + j * (w_basis - v_basis)
        corners = [
            west_corner,
            west_corner + v_basis,
            west_corner + v_basis + u_basis,
            west_corner + v_basis + u_basis + w_basis,
            west_corner + u_basis + w_basis,
            west_corner + w_basis,
            west_corner
        ]
        cell_row.append(rs.AddPolyline(corners))
        point_row.append(sum(corners[:-1], start=Vector3d(0, 0, 0)) / 6)
    cells.append(cell_row)
    points.append(point_row)

cells = th.list_to_tree(cells)
points = th.list_to_tree(points)
# ---------- end python_3_script_2 ----------
python_3_script_3 = Python3Script(
    size_u=Slider(1, range=0.1..2),
    size_v=Slider(1, range=0.1..2),
    extent_u=Slider(3, range=1..20),
    extent_v=Slider(3, range=1..20),
    theta=Slider(61, range=1..179))  # -> cells, points; inputs size_u: Double, size_v: Double, extent_u: Int32, extent_v: Int32, theta: Double
# ---------- python_3_script_3: Python ----------
from math import cos, sin, radians

import ghpythonlib.treehelpers as th
import rhinoscriptsyntax as rs
from Rhino.Geometry import Vector3d

theta = radians(theta)

u_basis = size_u * Vector3d(1, 0, 0)
v_basis = size_v * Vector3d(cos(theta), sin(theta), 0)

# Generate points
points = []
for u in range(extent_u + 1):
    row = []
    for v in range(extent_v + 1):
        row.append(u * u_basis + v * v_basis)
    points.append(row)

# Generate cells
cells = []
for u in range(extent_u):
    row = []
    for v in range(extent_v):
        row.append(rs.AddPolyline(
            [
                points[u][v],
                points[u + 1][v],
                points[u + 1][v + 1],
                points[u][v + 1],
                points[u][v]  # repeat the first point to make a closed loop
            ]
        ))
    cells.append(row)

points = th.list_to_tree(points)
cells = th.list_to_tree(cells)
# ---------- end python_3_script_3 ----------
python_3_script_4 = Python3Script(
    extent_right=Slider(3, range=1..20),
    extent_up=Slider(3, range=1..20),
    path=python_3_script.path,
    right_index=python_3_script.right_index,
    up_index=python_3_script.up_index)  # -> cells; inputs extent_right: Int32, extent_up: Int32, path: list of Vector3d, right_index: Int32, up_index: Int32
# ---------- python_3_script_4: Python ----------
import ghpythonlib.treehelpers as th
import rhinoscriptsyntax as rs
from Rhino.Geometry import Vector3d

cumulative_vectors = [Vector3d(0, 0, 0)]
print(type(path[0]))
for i, step in enumerate(path):
    cumulative_vectors.append(cumulative_vectors[i] + step)

basis_right = cumulative_vectors[right_index]
basis_up = cumulative_vectors[up_index]

cells = []
for i in range(extent_right):
    row = []
    for j in range(extent_up):
        start_point = i * basis_right + j * basis_up
        points = [
            start_point + vector
            for vector in cumulative_vectors
        ]
        row.append(rs.AddPolyline(points))
    cells.append(row)

cells = th.list_to_tree(cells)
# ---------- end python_3_script_4 ----------
custom_preview = CustomPreview(Material=ColourSwatch(SwatchColor=RGB(255, 0, 0)))
python_3_script_5 = Python3Script(x=flatten(python_3_script_4))  # -> a; inputs x: list of Curve
# ---------- python_3_script_5: Python ----------
import random

print(x)
random.shuffle(x)
a = x
print(a)
# ---------- end python_3_script_5 ----------
list_length = ListLength(List=python_3_script_5)
boundary_surfaces = BoundarySurfaces(Edges=python_3_script_5)
series = Series(Start=0, Step=1, Count=list_length)
gradient = Gradient(
    LowerLimit=0,
    UpperLimit=expr("x - 1", list_length),
    Parameter=series,
    stops=[0: RGB(242, 57, 0), 0.1: RGB(236, 27, 60), 0.2: RGB(210, 0, 118), 0.3: RGB(103, 0, 120), 0.4: RGB(39, 72, 161), 0.5: RGB(1, 192, 229), 0.6: RGB(18, 178, 90), 0.7: RGB(79, 186, 8), 0.8: RGB(220, 237, 32), 0.9: RGB(247, 159, 20), 1: RGB(243, 57, 0)])
create_material = CreateMaterial(Diffuse=gradient, Specular=RGB(255, 255, 255), Emission=RGB(0, 0, 0), Transparency=0, Shine=0)
custom_preview_2 = CustomPreview(Geometry=boundary_surfaces, Material=create_material)
