# Grasshopper definition life-stack.gh (Grasshopper 1.0.8)

panel = Panel("""x = 9, y = 10, rule = B3/S23:T13,10
bo$3bo$bob3o$4bobo$o5bobo2$2bo3bo$bo3bobo2$2b3o!""")
generation_count = Slider(50, range=1..100)
x_offset = Slider(0, range=-20..20)
y_offset = Slider(0, range=-20..20)
cube_color = ColourSwatch(SwatchColor=RGB(196, 196, 196))
python_3_script = Python3Script(rle_string=panel, generations=generation_count, offset_x=x_offset, offset_y=y_offset)  # -> out, corners; inputs generations: Int32, offset_x: Int32, offset_y: Int32
# ---------- python_3_script: Python ----------
# r: numpy

import itertools
import re

import numpy as np
from numpy.lib.stride_tricks import sliding_window_view

import ghpythonlib.treehelpers as th
from Rhino.Geometry import Vector3d

corners = []
grid_width, grid_height = None, None

def parse_rle():
    """Parses an RLE string and returns a set of live cell coordinates."""
    global grid_width, grid_height, offset_x, offset_y

    lines = [line.strip() for line in rle_string.splitlines()]
    lines = [line for line in lines if line and not line.startswith("#")]
    
    for i, line in enumerate(lines):
        if line.startswith("x"):
            header_match = re.match(r'x = (\d+), y = (\d+), rule = (.+)', line)
            width, height, rule = header_match.groups()
            width = int(width)
            height = int(height)
            rule_match = re.match(r'([^:]+)(:T(\d+),(\d+))?', rule)
            if None in rule_match.groups():
                raise ValueError("RLE header must include a toroidal rule! (Place \"T:width,height\" after \"rule = B3/S23\")")
            _, _, grid_width, grid_height = rule_match.groups()
            grid_width = int(grid_width)
            grid_height = int(grid_height)
            if width > grid_width or height > grid_height:
                raise ValueError("RLE pattern size is larger than the toroidal grid size!")
            offset_x += (grid_width - width) // 2
            offset_y += (grid_height - height) // 2
            break
    data_lines = lines[i + 1:]
    data = ''.join(data_lines)
    
    # Parse the RLE data
    x, y = 0, 0
    live_cells = set()
    
    for match in re.finditer(r'(\d*)([bo$!])', data):
        count, symbol = match.groups()
        count = int(count) if count else 1
        
        if symbol == 'b':
            x += count
        elif symbol == 'o':
            for _ in range(count):
                live_cells.add(((x + offset_x) % grid_width, (y + offset_y) % grid_height))
                x += 1
        elif symbol == '$':
            y += count
            x = 0
        elif symbol == '!':
            break  # End of pattern
    return live_cells

initial_on = list(parse_rle())
grid = np.zeros((grid_width, grid_height))
initial_on = np.asarray(initial_on)
grid[initial_on[:, 0], initial_on[:, 1]] = 1

def generation(state):
    padded = np.zeros((grid_width + 2, grid_height + 2))
    padded[1:-1, 1:-1] = state
    padded[1:-1, (0, -1)] = state[:, (-1, 0)]
    padded[(0, -1), 1:-1] = state[(-1, 0), :]
    padded[(0, 0, -1, -1), (0, -1, 0, -1)] = state[(-1, -1, 0, 0), (-1, 0, -1, 0)]

    window_view = sliding_window_view(padded, (3, 3))
    sums = np.add.reduce(window_view, (-1, -2))
    sums -= state

    new_state = state.copy()
    new_state[np.logical_and(state == 1, sums < 2)] = 0
    new_state[np.logical_and(state == 1, sums > 3)] = 0
    new_state[np.logical_and(state == 0, sums == 3)] = 1

    return new_state

for i in range(generations):
    slice_ = []
    idx = np.argwhere(grid == 1)
    for x, y in idx:
        slice_.append(Vector3d(float(x), float(y), i))
    corners.append(slice_)
    grid = generation(grid)

    if not np.any(grid == 1):
        print(f"Terminated early at generation {i}")
        break
else:
    print(f"Terminated at generation {generations}")

corners = th.list_to_tree(corners)
# ---------- end python_3_script ----------
panel_2 = Panel(python_3_script.out)
addition = Addition(A=python_3_script.corners, B="{1, 1, 1}")
create_material = CreateMaterial(Diffuse=cube_color, Specular=RGB(255, 255, 255), Emission=RGB(0, 0, 0), Transparency=0, Shine=0)
box_2pt = Box2Pt(PointA=python_3_script.corners, PointB=addition, Plane=PlaneXY(0, 0, 0))
custom_preview = CustomPreview(Geometry=box_2pt, Material=create_material)
