# Grasshopper definition simple-crawl.gh (Grasshopper 1.0.8)
# plug-ins: RhinoCodePluginGH

# ---- group: Inputs
number_slider = Slider(0.6, range=0.5..2.5)
number_slider_2 = Slider(7, range=0..10)
number_slider_3 = Slider(7, range=0..10)
number_slider_4 = Slider(577, range=0..1000)
size = Slider(0.16, range=0..1)
extent_x = Slider(32, range=0..100)
extent_y = Slider(32, range=0..100)

# ----
square = Square(Plane=PlaneXY(0, 0, 0), Size=number_slider, ExtentX=number_slider_2, ExtentY=number_slider_3)  # -> Cells, Points
make_grid_mesh_faces = MakeGridMeshFaces(extent_x=extent_x, extent_y=extent_y)
square_2 = Square(Plane=PlaneXY(0, 0, 0), Size=size, ExtentX=extent_x, ExtentY=extent_y)  # -> Cells, Points
create_crawl = Python3Script(points=square.Points, seed=number_slider_4)  # -> crawl; inputs points: tree of Point3d, seed: Int32
# ---------- create_crawl: Python ----------
import random

import ghpythonlib.treehelpers as th
import rhinoscriptsyntax as rs
from Rhino.Geometry import Vector3d

random.seed(seed)

points = th.tree_to_list(points)[0]
extent_x = len(points)
extent_y = len(points[0])

crawl = []

visited = set()
def can_visit(point):
    x, y = point
    if x < 0 or x >= extent_x:
        return False
    if y < 0 or y >= extent_y:
        return False
    return point not in visited

def neighbors_of(point):
    x, y = point
    return list(filter(can_visit, [
        (x + 1, y),
        (x, y + 1),
        (x - 1, y),
        (x, y - 1),
        (x + 1, y + 1),
        (x + 1, y - 1),
        (x - 1, y + 1),
        (x - 1, y - 1),
    ]))

start_x = random.randint(0, extent_x - 1)
start_y = random.randint(0, extent_y - 1)
start = (start_x, start_y)
neighbors = neighbors_of(start)
visited.add(start)
crawl.append(start)

while len(neighbors) > 0:
    chosen = random.choice(neighbors)
    visited.add(chosen)
    crawl.append(chosen)

    neighbors = neighbors_of(chosen)

crawl = rs.AddPolyline([
    points[x][y]
    for x, y in crawl
])
# ---------- end create_crawl ----------
center_grid_around_other = CenterGridAroundOther(points_to_center_on=square.Points, points_to_center=square_2.Points)

# ---- group: Geometry Previews
overlayed_grid_points = Point(center_grid_around_other)
crawl_grid_points = Point(square.Points)
crawl = Curve(create_crawl)

# ---- group: Get tangent at closest point on crawl
curve_closest_point = CurveClosestPoint(Point=center_grid_around_other, Curve=create_crawl)  # -> Point, Parameter, Distance
evaluate_curve = EvaluateCurve(Curve=create_crawl, Parameter=curve_closest_point.Parameter)  # -> Point, Tangent, Angle
line_sdl = LineSDL(Start=center_grid_around_other, Direction=evaluate_curve.Tangent, Length=expr("x * 0.5", size))

# ----
colour = Colour(evaluate_curve.Tangent)
construct_mesh = ConstructMesh(Vertices=flatten(center_grid_around_other), Faces=make_grid_mesh_faces, Colours=flatten(colour))

# ---- group: Geometry Previews
custom_preview = CustomPreview(Material=colour)

# ==== cluster MakeGridMeshFaces
extent_x = ClusterInput()
extent_y = ClusterInput()
series = Series(Start=0, Step=1, Count=extent_y)
series_2 = Series(Start=0, Step=1, Count=extent_x)
cross_reference = CrossReference(ListListA=series, ListListB=series_2, CrossMode=1)  # -> ListListA, ListListB
addition = Addition(A=extent_y, B=1)
multiplication = Multiplication(A=cross_reference.ListListB, B=addition)
addition_2 = Addition(A=cross_reference.ListListA, B=multiplication)
addition_3 = Addition(A=addition_2, B=1)
addition_4 = Addition(A=addition_2, B=addition)
addition_5 = Addition(A=addition_3, B=addition)
mesh_quad = MeshQuad(CornerA=addition_2, CornerB=addition_3, CornerC=addition_5, CornerD=addition_4)
faces = ClusterOutput(mesh_quad)

# ==== cluster CenterGridAroundOther
points_to_center_on = ClusterInput()
points_to_center = ClusterInput()
average = Average(Input=flatten(points_to_center_on))
average_2 = Average(Input=flatten(points_to_center))
subtraction = Subtraction(A=average, B=average_2)
move = Move(Geometry=points_to_center, Motion=subtraction)  # -> CenteredPoints, Transform
centered_points = ClusterOutput(move.CenteredPoints)
