# Grasshopper definition simplex-heightmap.gh (Grasshopper 1.0.8)

number_slider = Slider(40, range=2..250)
merge = Merge(
    Data1=Slider(2.5, range=0..3),
    Data2=Slider(0.4, range=0..3),
    Data3=Slider(0.35, range=0..3),
    Data4=Slider(0.3, range=0..3),
    Data5=Slider(0.2, range=0..3),
    Data6=Slider(0.15, range=0..3))
merge_2 = Merge(
    Data1=Slider(0.15, range=0..3),
    Data2=Slider(0.3, range=0..3),
    Data3=Slider(0.45, range=0..3),
    Data4=Slider(0.75, range=0..3),
    Data5=Slider(1, range=0..3),
    Data6=Slider(1.25, range=0..3))
square = Square(Plane=PlaneXY(0, 0, 0), Size=Slider(1.5, range=0.1..5), ExtentX=number_slider, ExtentY=Slider(30, range=2..250))  # -> Cells, Points
shortest_list = ShortestList(ListA=merge_2, ListB=merge, TrimMode=2)  # -> ListA, ListB
python_3_script = Python3Script(point=square.Points, seed=Slider(0, range=0..1000), frequencies=shortest_list.ListA, amplitudes=shortest_list.ListB)  # -> out, point; inputs point: Point3d, seed: Int32, frequencies: list of Double, amplitudes: list of Double
# ---------- python_3_script: Python ----------
# r: opensimplex

import opensimplex
if seed is not None and isinstance(seed, int):
    # This check is just to make sure we don't crash Rhino if the seed input isn't connected
    opensimplex.seed(seed)

for freq, amp in zip(frequencies, amplitudes):
    point.Z += amp * opensimplex.noise2(point.X * freq, point.Y * freq)
# ---------- end python_3_script ----------
addition = Addition(A=number_slider, B=1)
surface_from_points = SurfaceFromPoints(Points=flatten(python_3_script.point), UCount=addition, Interpolate=True)
create_material = CreateMaterial(
    Diffuse=ColourSwatch(SwatchColor=RGB(212, 212, 212)),
    Specular=RGB(255, 255, 255),
    Emission=RGB(0, 0, 0),
    Transparency=0,
    Shine=0)
custom_preview = CustomPreview(Geometry=surface_from_points, Material=create_material)
